# Grasshopper definition Rail2.gh (Grasshopper 1.0.7)

c_script = CSharpScript(x="210", y="-12")  # -> out, A, B, C; inputs x: Double, y: Double, p1: Point3d
# ---------- c_script: C# ----------
    Point3d des = new Point3d(x, y, 0);
    for(double i = -15;i <= 65;i += 0.1){
      Curve r1 = Rail(i);
      double t;
      r1.ClosestPoint(des, out t);
      Point3d pt = r1.PointAt(t);
      if(pt.DistanceTo(des) < 0.1){
        A = i;B = r1;C = des;
        return;
      }
    }
# ---------- c_script: C# additional code ----------
  Curve Rail(double x){

    List<Point3d> ps = new List<Point3d>();
    double volume = 1.0 / 35.0;
    Vector3d v0 = new Vector3d(80, 0, 0);
    v0.Rotate(x * Math.PI / 180, Vector3d.ZAxis);
    Point3d p0 = new Point3d(0, 0, 0);
    double dt = 0.1;
    for(double i = 0;i < 2 / dt;i += dt){
      ps.Add(p0);
      double speed = v0.Length;
      double drag = speed * speed * 0.1 * volume * 10.0;
      drag *= 0.1;
      // Print(drag.ToString());
      Vector3d v1 = new Vector3d(v0);
      v1.Unitize();
      v1 *= -drag;

      Vector3d v2 = new Vector3d(0, -9.80665, 0);
      v2 *= volume * 10.0;
      // Print(v1.ToString() + "," + v2.ToString());
      v0 = v0 + (v1 + v2) * dt;  
      if(v0.Length > 64*0.95){
        v0.Unitize();
        v0 *= 64*0.95;
      }
      p0 = p0 + v0 * dt / 2.0;
    }
    return Curve.CreateInterpolatedCurve(ps, 3);

  }
# ---------- end c_script ----------
panel = Panel(c_script.A)
