# Grasshopper definition Rail3.gh (Grasshopper 1.0.7)

c_script = CSharpScript(angle=Slider(20, range=0..90), time=Slider(4.89, range=0..20))  # -> out, A, B; inputs angle: Double, time: Double
# ---------- c_script: C# ----------
    double time1 = 0;
    A = Rail1(angle, time);
    B = time1;
# ---------- c_script: C# additional code ----------
  public Polyline Rail1(double angle, double time){
    double volume = Mass / Density;
    Vector3d frontVel = new Vector3d(maxVelocity * 0.95, 0, 0);
    Point3d localFront = new Point3d(0, 0, 0);
    Polyline ps = new Polyline();
    ps.Add(localFront);
    frontVel.Transform(Transform.Rotation(angle / 180.0 * Math.PI, Vector3d.ZAxis, localFront));
    for(double i = 0;i < time;i += dt){
      double speed = frontVel.Length;
      double drag = speed * speed * WaterDragCoefficient * volume * NeutralDensity;
      drag *= 9.82*0.02;
      Vector3d dragVec = new Vector3d(frontVel);
      dragVec.Unitize();
      dragVec *= -drag;
      Vector3d buoyancy = -Gravity * forceFactor * volume * NeutralDensity;
      localFront = localFront + frontVel * dt + (dragVec + buoyancy + Gravity ) / 2 * dt * dt;
      frontVel = frontVel + (dragVec + buoyancy + Gravity  ) * dt;
      ps.Add(localFront);
    }
    return ps;
  }
  public  double WaterDragCoefficient = 0.1;
  public  double forceFactor = 1.0;
  public  double maxVelocity = 64.0;
  public  Vector3d Gravity = new Vector3d(0, -9.82, 0);
  public  double Density = 35,Mass = 1,Width = 2.15,Height = 0.30;
  public  double dt = 1.0 / 60.0;
  public  double NeutralDensity = 10.0;
# ---------- end c_script ----------
panel = Panel(c_script.out)
cp = ControlPoints(Curve=c_script.A)  # -> Points, Weights, Knots
